# Dynamo graph Ifc-SceneExportWithAssimp.dyn (Dynamo 2.12.0.5650)
# packages: TRex 1.0.21239.39970

# group: File logger
file_path = Filename("Out\IfcLoad-SceneExport.log")
file_logger = FileLog(fileName=file_path, LogEventLevel=1)

# group: Load IFC
file_path_2 = Filename("Ifc4\IfcSampleHouse.ifc")
ifc_load = IfcLoadStoreNodeModel(fileName=file_path_2, logger=file_logger, IsCancelable=true)  # unwired: prefs

graphicalContexts = TRex.Store.IfcModel.GraphicalContexts(ifcModel=ifc_load)

# group: Build component interim scene
code_block = CodeBlock { -9.23; -2.75; -0.47; }
byXYZ = TRex.Geom.XYZs.ByXYZ(x=code_block.out0, y=code_block.out1, z=code_block.out2)
unit_scale = UnitScaleNodeModel(SelectedUnitScale={UnitsPerMeter: 1, Name: "Meter", Reference: "m"})
select_items_from = SelectingItemListNodeModel(items=graphicalContexts, SelectedValue=["Body"])

crs_transform = CRSTransformNodeModel(offset=byXYZ, Transform={Right: "PositiveX", Up: "PositiveZ", Forward: "PositiveY", SourceCRS: null, Name: "RHS Z-Up"})
build_settings = SceneBuildSettingsNodeModel(crs=crs_transform, unitScale=unit_scale, context=select_items_from, TransformationStrategy=0, IdentificationStrategy=0, PositioningStrategy=0)

# group (continued): Build component interim scene
build_scene = SceneBuildNodeModel(settings=build_settings, ifcModel=ifc_load, IsCancelable=true)

# group: Relocate output
directory_path = Directory(".\Out")
relocatePath = TRex.Export.ComponentScene.RelocatePath(componentScene=build_scene, newPathName=directory_path)

# group: Export as FBX with Y axis up
unit_scale_2 = UnitScaleNodeModel(nested=unit_scale, SelectedUnitScale={UnitsPerMeter: 39.37008, Name: "Inch", Reference: "in"})
crs_transform_2 = CRSTransformNodeModel(crs=crs_transform, Transform={Right: "PositiveX", Up: "PositiveY", Forward: "PositiveZ", SourceCRS: {Right: "PositiveX", Up: "PositiveZ", Forward: "PositiveY", SourceCRS: null, Name: "RHS Z-Up"}, Name: "LHS Y-Up"})
export_scene_assimp = SceneExportNodeModel(scene=relocatePath, unitScale=unit_scale_2, crs=crs_transform_2, Selected={ID: "fbx", Extension: "fbx", Description: "Autodesk FBX (binary)"}, IsCancelable=false)

# group: Logging output
log_filter = LogFilterNodeModel(model=export_scene_assimp, LogCount=10, LogMinSeverity=0)  # unwired: mask
data_preview = DataTablePreviewNodeModel(in=log_filter, MinCount=1, MaxCount=100, Count=10)

# group: JSON dump
save_scene = SceneSaveNodeModel(scene=relocatePath, Selected={ID: "json", Extension: "json", Description: "JSON Text"}, IsCancelable=false)  # unwired: separator

# group: Logging output
log_filter_2 = LogFilterNodeModel(model=save_scene, LogCount=10, LogMinSeverity=0)  # unwired: mask
data_preview_2 = DataTablePreviewNodeModel(in=log_filter_2, MinCount=1, MaxCount=100, Count=10)
