# Dynamo graph IfcLoad-CheckGuids-SaveReport.dyn (Dynamo 2.10.1.3976)
# packages: TRexIfc 0.1.0.0

file_path = Filename("Out\IfcLoad-CheckGuids-SaveReport.xlsx")
now = DateTime.Now()
code_block = CodeBlock { "yyyy-MM-dd-HHmmss"; }
format = DateTime.Format(dateTime=now, format=code_block)
code_block_2 = CodeBlock { 0; 0; }
file_path_2 = Filename("Ifc4\IfcSampleHouse.ifc")
file_path_3 = Filename("Out\IfcLoad-CheckGuids-SaveReport.log")
file_logger = FileLog(fileName=file_path_3, LogEventLevel=1)
ifc_load = IfcLoadStoreNodeModel(fileName=file_path_2, logger=file_logger, IsCancelable=true)  # unwired: prefs
byEmptyStore = TRex.Validation.IfcGuidStore.ByEmptyStore()
ifcguid_validation = IfcGuidCheckValidationNodeModel(ifcModel=ifc_load, guidStore=byEmptyStore, IsCancelable=true)
ifcreport_domain = IfcReportDomainComposingNodeModel(Selected=[14])
messages = TRex.Validation.IfcValidationResult.Messages(ifcValidationResult=ifcguid_validation, reportFilter=ifcreport_domain)
toData = TRex.Validation.IfcValidationMessage.ToData(ifcValidationMessage=messages)
exportExcel = Data.ExportExcel(filePath=file_path, sheetName=format, startRow=code_block_2.out0, startCol=code_block_2.out1, data=toData)
ifcGuidStore = TRex.Validation.IfcGuidCheckResult.IfcGuidStore(ifcGuidCheckResult=ifcguid_validation)
countInstances = TRex.Validation.IfcGuidStore.CountInstances(ifcGuidStore=ifcGuidStore)
duplicateUsageCountInstances = TRex.Validation.IfcGuidStore.DuplicateUsageCountInstances(ifcGuidStore=ifcGuidStore)
toDataOfDuplicateUsage = TRex.Validation.IfcGuidStore.ToDataOfDuplicateUsage(ifcGuidStore=ifcGuidStore)
