# Dynamo graph IfcLoad-Evaluate.dyn (Dynamo 2.6.1.8786)
# packages: TRexIfc 1.0.20304.44022

# group: File logger
file_path = Filename(".\Out\Log-Evaluate.log")
file_logger = FileLog(fileName=file_path, LogEventLevel=1)

# group: Load IFC
file_path_2 = Filename("Ifc4\IfcSampleHouse.ifc")
ifc_load = IfcLoadStoreNodeModel(fileName=file_path_2, logger=file_logger, IsCancelable=true)  # unwired: prefs

# group: Evaluate IfcPropertySets
schema = TRex.Store.IfcModel.Schema(ifcModel=ifc_load)
watch = Watch(schema)
productTypes = TRex.Store.IfcModel.ProductTypes(ifcModel=ifc_load)
watch_2 = Watch(productTypes)
propertySetsPerProductType = TRex.Store.IfcModel.PropertySetsPerProductType(ifcModel=ifc_load)
watch_3 = Watch(propertySetsPerProductType)
