# Dynamo graph IfcLoad-SceneExport.dyn (Dynamo 2.6.0.8481)
# packages: TRexIfc 0.1.0.0

file_path = Filename("Ifc4\IfcSampleHouse.ifc")
file_path_2 = Filename("Out\IfcLoad-SceneExport.log")
file_logger = FileLog(fileName=file_path_2, LogEventLevel=1)
ifc_load = IfcLoadStoreNodeModel(fileName=file_path, logger=file_logger, IsCancelable=true)  # unwired: prefs
byModelDefaults = Store.IfcTessellationPrefs.ByModelDefaults(ifcModel=ifc_load)
toValues = Store.IfcTessellationPrefs.ToValues(ifcTessellationPrefs=byModelDefaults)
canonicalName = Store.IfcModel.CanonicalName(ifcModel=ifc_load)
directory_path = Directory("C:\Workspace\Git\BitubTRexDynamo\Examples\Out")
relocatePath = Store.IfcModel.RelocatePath(ifcModel=ifc_load, newPathName=directory_path)
ifc_save = IfcSaveStoreNodeModel(ifcModel=relocatePath, SelectedOption="ifczip", IsCancelable=true)  # unwired: separator
logMessages = Store.IfcModel.LogMessages(ifcModel=ifc_save)
code_block = CodeBlock { 0; 0; 0; }
byCoordinates = Geom.XYZ.ByCoordinates(x=code_block.out0, y=code_block.out1, z=code_block.out2)
graphicalContexts = Store.IfcModel.GraphicalContexts(ifcModel=ifc_load)
select_items_from = SelectiveItemListNodeModel(items=graphicalContexts)
scene_export_settings = SceneExportSettingsNodeModel(offset=byCoordinates, providedContexts=select_items_from, logger=file_logger, ProvidedGraphicalContext=["Axis", "Body", "Box", "FootPrint"], SelectedGraphicalContext=["Body"], TransformationStrategy=0, PositioningStrategy=0)  # unwired: unitsPerMeter
scene_export = SceneExporterNodeModel(sceneExporter=scene_export_settings, ifcModel=ifc_load, pathName=directory_path, SelectedOption="scene", IsCancelable=true)  # unwired: separator
